vi "RiskReduction2.gvi"   [LabVIEW NXG 2.0.0]
panel controls:
  "Numeric": f64
  "Numeric_3": f64
  "Numeric_5": f64
panel indicators:
  "Numeric_2": f64
  "Numeric_4": f64
  "Numeric_6": f64
diagram:
  Add($Numeric_3, 5) -> w1
  $Numeric_4 <- w1
  Subtract(x=$Numeric_5, y=3) -> w2
  $Numeric_6 <- w2
  Add($Numeric, 5) -> w3
  Multiply(w3, 2) -> w4
  $Numeric_2 <- w4
